vi "Simulate Temperature Acquisition - Station 2.gvi"   [LabVIEW NXG 2.0.0]
outputs:
  "Temperature": f64
diagram:
  w1 = [89.9140625, 90.40234375, 90.890625, 90.40234375, 89.9140625, 89.9140625, 88.9375, 88.9375, 88.9375, 87.9609375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]
  # One simulated temperature data value is generated for each call to this subVI. Simulated data repeats in cycles of 100.
  s1 = uninitialised  # shift register
  while {
    Array Index(array=w1) -> (out0[s1]=w2)
    Increment(x=s1) -> w3
    Quotient And Remainder(x=w3, y=100) -> (x-y*floor(x/y)=w4)
    next s1 = w4
    stop if TRUE
  }
  $Temperature <- w2
