vi "Simulate Temperature Acquisition - Station 3.gvi"   [LabVIEW NXG 2.0.0]
outputs:
  "Temperature": f64
diagram:
  w1 = [91.619921875, 91.619921875, 91.0828125, 91.0828125, 90.545703125, 90.545703125, 90.00859375, 90.00859375, 90.00859375, 90.00859375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]
  # One simulated temperature data value is generated for each call to this subVI. Simulated data repeats in cycles of 100.
  s1 = uninitialised  # shift register
  while {
    Array Index(array=w1) -> (out0[s1]=w2)
    Increment(x=s1) -> w3
    Quotient And Remainder(x=w3, y=100) -> (x-y*floor(x/y)=w4)
    next s1 = w4
    stop if TRUE
  }
  $Temperature <- w2
