vi "Simulate Temperature Acquisition - Station 4.gvi"   [LabVIEW NXG 2.0.0]
outputs:
  "Temperature": f64
diagram:
  w1 = [81.323046875, 83.471484375, 85.0828125, 85.619921875, 85.0828125, 85.0828125, 84.545703125, 84.545703125, 86.15703125, 87.23125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]
  # One simulated temperature data value is generated for each call to this subVI. Simulated data repeats in cycles of 100.
  s1 = uninitialised  # shift register
  while {
    Array Index(array=w1) -> (out0[s1]=w2)
    Increment(x=s1) -> w3
    Quotient And Remainder(x=w3, y=100) -> (x-y*floor(x/y)=w4)
    next s1 = w4
    stop if TRUE
  }
  $Temperature <- w2
