vi "Limit Test.gviweb"   [LabVIEW NXG 2.0.0]
inputs:
  "Temperature": f64
  "High Limit": f64 = 85
  "Low Limit": f64 = 75
outputs:
  "Temperature History": T1
  "Alarm": bool
types:
  T1 = cluster{"Element 1": f64, "Element 2": f64, "Element 3": f64}
diagram:
  Build Cluster($Temperature, $"High Limit", $"Low Limit") -> w1
  $"Temperature History" <- w1
  Is Greater(x=$Temperature, y=$"High Limit") -> w2
  Is Less(x=$Temperature, y=$"Low Limit") -> w3
  Logical Or(w2, w3) -> w4
  $Alarm <- w4
