vi "Main.gviweb"   [LabVIEW NXG 4.0.0]
panel controls:
  "High Limit": f64 = 85
  "Low Limit": f64 = 75
  "Sites": i32 = -1
panel indicators:
  "Temperature (F)": f64
  "Temperature History": T1
  "Alarm": bool
  "URL Image_2": string
  "URL Image_4": string
  "URL Image_3": string
  "URL Image_5": string
  "URL Image_6": string
  "URL Image_7": string
  "URL Image": string
  "URL Image_9": string
  "URL Image_8": string
  "URL Image_10": string
types:
  T1 = cluster{"Element 1": f64, "Element 2": f64, "Element 3": f64}
uses:
  NI::Skyline::Configuration::Open Configuration API Key.gvi
  NI::Skyline::TagHTTP::Open Tag.gvi
  NI::Skyline::TagHTTP::Read Tag (DBL).gvi
  Application::Limit Test.gviweb
  NI::Skyline::TagHTTP::Close Tag (Single).gvi
  NI::Skyline::Configuration::Close Configuration.gvi
diagram:
  call "Open Configuration API Key.gvi"(server url="https://api.systemlinkcloud.com", api key="44lRtbtcuT5fdgwWAnjj1RQHSNM_2VazXWfNL-QaZj") -> (configuration=w1, error out=w2)
  w3 = ["Station1.Temperature", "Station2.Temperature", "Station3.Temperature", "Station4.Temperature"]
  for {
    w4 = each element of w3
    call "Open Tag.gvi"(path=w4, data type="Double", error in=w2, configuration=w1) -> (tag=w6, error out=w7)
    append w6 to w5
  }
  while {
    Wait(time to wait=500)
    Is Equal(x=$Sites, y=-1) -> w8
    case (w8) {
      frame True {
        # If site number
        # is -1, use default
        # temperature values
        w9 = 0
        w10 = w7
      }
      frame False {
        Array Index(array=w5) -> (out0[$Sites]=w11)
        call "Read Tag (DBL).gvi"(tag in=w11, error in=w7) -> (value=w9, error out=w10)
      }
    }
    $"Temperature (F)" <- w9
    call "Limit Test.gviweb"(Temperature=w9, High Limit=$"High Limit", Low Limit=$"Low Limit") -> (Temperature History=w12, Alarm=w13)
    $"Temperature History" <- w12
    $Alarm <- w13
    stop if FALSE
  }
  for {
    w14 = each element of w5
    call "Close Tag (Single).gvi"(tag=w14, error in=w10) -> (error out=w15)
  }
  call "Close Configuration.gvi"(configuration=w1, error in=w15)
