vi "Temperature Monitoring.gvi"   [LabVIEW NXG 4.0.0]
inputs:
  "error in": error
outputs:
  "error out": error
panel controls:
  "High Limit": f64 = 90
  "Low Limit": f64 = 84.6153846154
  "Stop": bool
panel indicators:
  "Temperature History": f64[][]
  "Warning Messages": string[]
  "Temperatures": f64[]
uses:
  NI::Skyline::Configuration::Open Configuration API Key.gvi
  NI::Skyline::TagHTTP::Open Tag.gvi
  NI::Skyline::TagHTTP::Write Tag (DBL).gvi
  NI::Skyline::TagHTTP::Close Tag (Single).gvi
  NI::Skyline::Configuration::Close Configuration.gvi
diagram:
  call "Open Configuration API Key.gvi"(server url="https://api.systemlinkcloud.com", api key="MqQmXUCq69L9mN3EzumXJ216QVTJsj2nHkwvm9TSsh", error in=$"error in") -> (configuration=w1, error out=w2)
  w3 = ["Station1.Temperature", "Station2.Temperature", "Station3.Temperature", "Station4.Temperature"]
  for {
    w4 = each element of w3
    call "Open Tag.gvi"(path=w4, data type="Double", error in=w2, configuration=w1) -> (tag=w6, error out=w7)
    append w6 to w5
  }
  while {
    Wait(time to wait=400)
    for (iteration -> i1) {
      w8 = each element of w5
      # Provide different simulated
      # data for each station
      case (i1) {
        frame 1 {
          call "Simulate Temperature Acquisition - Station 2.gvi"() -> (Temperature=w13)
        }
        frame 2 {
          call "Simulate Temperature Acquisition - Station 3.gvi"() -> (Temperature=w13)
        }
        frame 3 {
          call "Simulate Temperature Acquisition - Station 4.gvi"() -> (Temperature=w13)
        }
        frame 0, Default {
          call "Simulate Temperature Acquisition - Station 1.gvi"() -> (Temperature=w13)
        }
      }
      w14 = $"High Limit"
      Is Greater(x=w13, y=w14) -> w15
      w16 = $"Low Limit"
      Is Less(x=w13, y=w16) -> w17
      Logical Or(w15, w17) -> w18
      case (w18) {
        frame False, Default {
          w19 = ""
        }
        frame True {
          case (w15) {
            frame False, Default {
              w19 = "UNDER TEMP"
            }
            frame True {
              w19 = "OVER TEMP"
            }
          }
        }
      }
      call "Write Tag (DBL).gvi"(tag in=w8, value=w13, error in=w7) -> (tag out=w20, error out=w21)
      append w20 to w9
      append w21 to w10
      append w19 to w11
      append w13 to w12
    }
    $Temperatures <- w12
    Build Array(w12, w14, w16) -> w22
    Build Array(w22) -> w23
    $"Temperature History" <- w23
    $"Warning Messages" <- w11
    stop if $Stop
  }
  for {
    w24 = each element of w9
    w25 = each element of w10
    call "Close Tag (Single).gvi"(tag=w24, error in=w25) -> (error out=w26)
  }
  call "Close Configuration.gvi"(configuration=w1, error in=w26) -> (error out=w27)
  $"error out" <- w27
